# Grasshopper definition PointCloudVegetationAll.gh (Grasshopper 1.0.4)
# plug-ins: Volvox, treesloth01, NDVIColorRange, NDVICalculator, Tarsier

# ---- group: UPDATE THE PATH HERE
path = FilePath("C:\Users\darks\Desktop\PhotogrammetryWorkshop\ValldauraExportFiles\valldaura.pts")

# ---- group: Simple cull base on list
path_2 = FilePath(path)  # disabled
number_slider = Slider(0.01, range=0..0.1)
cloudload = LoadCloud(FilePath=path_2, Mask="x y z n r g b", Percent=Slider(0.001, range=0..0.01))
decloud = DeconstructCloud(Cloud=cloudload)  # -> Points, Normals, simplify(Colors)
lng = ListLength(List=decloud.Colors)
panel = Panel(decloud.Colors)
panel_2 = Panel(lng)
series = Series(Start=0, Step=1, Count=Slider(100, range=0..100))
# CULL POINTS BASED ON COLOR COMPARISON
item = ListItem(List=decloud.Colors, Index=series, Wrap=True)
split = TextSplit(Text=item, Separators=",")  # -> simplify(Result)
panel_3 = Panel(split)
# CULL POINT OF THE LIST
data = Data(decloud.Colors)
split_2 = TextSplit(Text=data, Separators=",")  # -> simplify(Result)
equals = Equality(FirstNumber=split_2, SecondNumber=split)  # -> Equality, Inequality
ma = MassAddition(Input=equals.Equality)  # -> flatten(Result), PartialResults
ma_2 = MassMultiplication(Input=equals.Equality)  # -> flatten(Result), PartialResults
panel_4 = Panel(ma.Result)
panel_5 = Panel(ma_2.Result)
unweave = Unweave(List=data, UnweavePattern=ma_2.Result)  # -> Data0, Data1
lng_2 = ListLength(List=unweave.Data1)
dup = DuplicateData(Data=ColourSwatch(SwatchColor=RGB(255, 0, 0)), Number=lng_2, Order=True)
weave = Weave(Pattern=ma_2.Result, Stream0=unweave.Data0, Stream1=dup, NullGaps=False)
panel_6 = Panel(weave)
cloud = ConstructCloud(Points=decloud.Points, Normals=decloud.Normals, Colors=weave)
number_slider_2 = Slider(1, range=0.5..10)  # disabled
voxelc = VoxelColored(Cloud=cloud, VoxelSize=number_slider_2)  # disabled

# ---- group: SEPARATING BY COLOURS
number_slider_3 = Slider(34, range=0..100)
path_3 = FilePath(path)  # disabled
number_slider_4 = Slider(0.001, range=0..0.01)
box = CenterBox(Base=PlaneXY(0, 0, 0), X=number_slider_3, Y=number_slider_3, Z=number_slider_3)
bcrop = BoxCrop(Box=box)
cloudload_2 = LoadCloud(FilePath=path_3, Mask="x y z n r g b", Percent=Slider(0.1, range=0..0.1))
cloude = CloudEngine(Cloud=cloudload_2, Instruction0=bcrop)
series_2 = Series(Start=0, Step=1, Count=Slider(100, range=0..100))
decloud_2 = DeconstructCloud(Cloud=cloude)  # -> Points, Normals, simplify(Colors)
bnd = Bounds(Numbers=series_2)
dedomain = DeconstructDomain(Domain=bnd)  # -> Start, End
lng_3 = ListLength(List=decloud_2.Colors)
panel_7 = Panel(decloud_2.Colors)
gradient = Gradient(LowerLimit=0, UpperLimit=dedomain.End, Parameter=series_2, stops=[0: RGB(8, 4, 4), 1: RGB(8, 7, 7)])
panel_8 = Panel(gradient)
panel_9 = Panel(lng_3)
split_3 = TextSplit(Text=gradient, Separators=",")  # -> simplify(Result)
legend = Legend(Colour=gradient, Tags=["One Fish", "Two Fish", "Red Fish", "Blue Fish"], LegendType=1)
data_2 = Data(decloud_2.Colors)
panel_10 = Panel(split_3)
split_4 = TextSplit(Text=data_2, Separators=",")  # -> simplify(Result)
pt = Point(data_2)
item_2 = ListItem(List=split_4, Index=0, Wrap=True)  # -> Item, Item1, Item2
item_3 = ListItem(List=split_3, Index=0, Wrap=True)  # -> Item, Item1, Item2
item_4 = ListItem(List=split_4, Index=0, Wrap=True)  # -> Item, Item1, Item2
panel_11 = Panel(split_4)
pt_2 = ConstructPoint(XCoordinate=item_2.Item, YCoordinate=item_2.Item1, ZCoordinate=item_2.Item2)  # -> flatten(Point)
panel_12 = Panel(pt_2)
pt_3 = ConstructPoint(XCoordinate=item_4.Item, YCoordinate=item_4.Item1, ZCoordinate=item_4.Item2)  # -> flatten(Point)
pt_4 = ConstructPoint(XCoordinate=item_3.Item, YCoordinate=item_3.Item1, ZCoordinate=item_3.Item2)  # -> flatten(Point)
num = Number(pt_2)
panel_13 = Panel(num)
num_2 = Number(pt_4)
similar = Similarity(FirstNumber=num, SecondNumber=num_2, Threshold=Slider(57, range=0..100))  # -> Similarity, AbsoluteDifference
data_3 = Data(similar.Similarity)
unweave_2 = Unweave(List=data_2, UnweavePattern=data_3)  # -> Data0, Data1
lng_4 = ListLength(List=unweave_2.Data1)
ma_3 = MassAddition(Input=similar.Similarity)  # -> Result, PartialResults
dup_2 = DuplicateData(Data=ColourSwatch(SwatchColor=RGB(255, 0, 0)), Number=lng_4, Order=True)
panel_14 = Panel(ma_3.Result)
weave_2 = Weave(Pattern=data_3, Stream0=unweave_2.Data0, Stream1=dup_2, NullGaps=False)
cloud_2 = ConstructCloud(Points=decloud_2.Points, Normals=decloud_2.Normals, Colors=weave_2)
cdel = DelaunayColored(Cloud=cloud_2, Plane=PlaneXY(0, 0, 0))
voxelc_2 = VoxelColored(Cloud=cloud_2, VoxelSize=Slider(1, range=0.5..10))  # disabled

# ----
panel_15 = Panel(path)
cdel_2 = DelaunayColored(Cloud=cloud, Plane=PlaneXY(0, 0, 0))
path_4 = FilePath(path)  # disabled
path_5 = FilePath(path)  # disabled

cloudload_3 = LoadCloud(FilePath=path_4, Mask="x y z n r g b", Percent=Slider(0.05, range=0..0.1))
decloud_3 = DeconstructCloud(Cloud=cloudload_3)  # -> Points, Normals, simplify(Colors)
panel_16 = Panel(decloud_3.Colors)
# COLOR  HSL COMPARISON
data_4 = Data(decloud_3.Colors)
ahsl = SplitAHSL(Colour=[ColourSwatch(SwatchColor=RGB(56, 64, 35)), ColourSwatch(SwatchColor=RGB(97, 99, 60)), ColourSwatch(SwatchColor=RGB(157, 163, 49))])  # -> Alpha, Hue, Saturation, Luminance
ahsl_2 = SplitAHSL(Colour=data_4)  # -> Alpha, Hue, Saturation, Luminance
similar_2 = Similarity(FirstNumber=ahsl_2.Hue, SecondNumber=graft(ahsl.Hue), Threshold=Slider(9, range=0..100))  # -> Similarity, AbsoluteDifference
flip = FlipMatrix(Data=similar_2.Similarity)
ma_4 = MassAddition(Input=flip)  # -> Result, PartialResults
larger = LargerThan(FirstNumber=ma_4.Result, SecondNumber="0")  # -> flatten(LargerThan), OrEqualTo
data_5 = Data(larger.LargerThan)
unweave_3 = Unweave(List=data_4, UnweavePattern=data_5)  # -> Data0, Data1
lng_5 = ListLength(List=unweave_3.Data1)
dup_3 = DuplicateData(Data=ColourSwatch(SwatchColor=RGB(0, 255, 255)), Number=lng_5, Order=True)
weave_3 = Weave(Pattern=data_5, Stream0=unweave_3.Data0, Stream1=dup_3, NullGaps=False)
cloud_3 = ConstructCloud(Points=decloud_3.Points, Normals=decloud_3.Normals, Colors=weave_3)  # disabled

# ---- group: NDVI ANALYSIS
number_slider_5 = Slider(0.001, range=0..0.01)
cloudload_4 = LoadCloud(FilePath=path_5, Mask="x y z n r g b", Percent=Slider(0.09, range=0..0.1))
decloud_4 = DeconstructCloud(Cloud=cloudload_4)  # -> Points, Normals, simplify(Colors)
panel_17 = Panel(decloud_4.Colors)
# NDVI ANALYSIS
data_6 = Data(decloud_4.Colors)
argb = SplitARGB(Colour=data_6)  # -> Alpha, Red, Green, Blue
ndvical = NDVICalculator(NIR=argb.Red, VIS=argb.Blue)
multiplication = Multiplication(A=ndvical, B=Slider(2, range=0..10))
ndvicolor = NDVIColorRange(NDVI=multiplication)
number_slider_6 = Slider(1, range=0.5..10)  # disabled
cloud_4 = ConstructCloud(Points=decloud_4.Points, Normals=decloud_4.Normals, Colors=ndvicolor)  # disabled

# ----
cdel_3 = DelaunayColored(Cloud=cloud_4, Plane=PlaneXY(0, 0, 0))  # disabled
voxelc_3 = VoxelColored(Cloud=cloud_4, VoxelSize=number_slider_6)  # disabled
cdel_4 = DelaunayColored(Cloud=cloud_3, Plane=PlaneXY(0, 0, 0))  # disabled

number_slider_7 = Slider(0.01, range=0..0.1)

# ---- group: Import Point Cloud
cloudload_5 = LoadCloud(FilePath=path, Mask="x y z n r g b", Percent=Slider(0.001, range=0..0.01))

# ----
decloud_5 = DeconstructCloud(Cloud=cloudload_5)  # -> Points, Normals, simplify(Colors)
series_3 = Series(Start=0, Step=1, Count=Slider(10, range=0..20))
# CULL POINT BASED ON COLORS
construct = ConstructPointCloud(Points=decloud_5.Points, Colours=decloud_5.Colors)
gradient_2 = Gradient(
    LowerLimit=0,
    UpperLimit=1,
    Parameter=series_3,
    stops=[0: RGB(14, 16, 20), 0.25: RGB(98, 119, 148), 0.5: RGB(79, 84, 54), 0.75: RGB(107, 115, 71), 1: RGB(189, 180, 64)])
panel_18 = Panel(construct)
panel_19 = Panel(gradient_2)
filter = FilterPointCloud(PointCloud=construct, Colours=gradient_2, Thresholds=Slider(0.2, range=0..1), invert=False)
panel_20 = Panel(filter)
deconstruct = DeconstructPointCloud(PointCloud=filter)  # -> Points, Colours, Normals
cloud_5 = ConstructCloud(Points=deconstruct.Points, Colors=deconstruct.Colours)
voxelc_4 = VoxelColored(Cloud=cloud_5, VoxelSize=Slider(1, range=0.5..10))

decloud_6 = DeconstructCloud(Cloud=cloudload_5)  # -> Points, Normals, simplify(Colors)
lng_6 = ListLength(List=decloud_6.Colors)
panel_21 = Panel(decloud_6.Colors)
panel_22 = Panel(lng_6)  # disabled
decloud_7 = DeconstructCloud(Cloud=cloudload_5)  # -> Points, Normals, simplify(Colors)
decloud_8 = DeconstructCloud(Cloud=cloud_5)  # -> Points, Normals, simplify(Colors)
fsim = FindSimilarMember(Data=decloud_8.Colors, Set=decloud_6.Colors)  # -> Hit, Index
replace = ReplaceItems(List=decloud_7.Colors, Item=ColourSwatch(SwatchColor=RGB(255, 255, 255)), Indices=fsim.Index, Wrap=False)
cloud_6 = ConstructCloud(Points=decloud_6.Points, Colors=replace)
voxelc_5 = VoxelColored(Cloud=cloud_6, VoxelSize=Slider(1, range=0.5..10))
