# Grasshopper definition PointCloudVegetationColorComparison.gh (Grasshopper 1.0.4)
# plug-ins: Volvox, treesloth01

# ---- group: PATH OF YOUR FILE HERE
path = FilePath()

# ----
panel = Panel(path)
cloudload = LoadCloud(FilePath=path, Mask="x y z n r g b", Percent=Slider(0.05, range=0..0.1))
decloud = DeconstructCloud(Cloud=cloudload)  # -> Points, Normals, simplify(Colors)
panel_2 = Panel(decloud.Colors)
data = Data(decloud.Colors)
ahsl = SplitAHSL(Colour=[ColourSwatch(SwatchColor=RGB(56, 64, 35)), ColourSwatch(SwatchColor=RGB(97, 99, 60)), ColourSwatch(SwatchColor=RGB(157, 163, 49))])  # -> Alpha, Hue, Saturation, Luminance
ahsl_2 = SplitAHSL(Colour=data)  # -> Alpha, Hue, Saturation, Luminance
similar = Similarity(FirstNumber=ahsl_2.Hue, SecondNumber=graft(ahsl.Hue), Threshold=Slider(9, range=0..100))  # -> Similarity, AbsoluteDifference
flip = FlipMatrix(Data=similar.Similarity)
ma = MassAddition(Input=flip)  # -> Result, PartialResults
larger = LargerThan(FirstNumber=ma.Result, SecondNumber="0")  # -> flatten(LargerThan), OrEqualTo
data_2 = Data(larger.LargerThan)
unweave = Unweave(List=data, UnweavePattern=data_2)  # -> Data0, Data1
lng = ListLength(List=unweave.Data1)
dup = DuplicateData(Data=ColourSwatch(SwatchColor=RGB(0, 255, 255)), Number=lng, Order=True)
weave = Weave(Pattern=data_2, Stream0=unweave.Data0, Stream1=dup, NullGaps=False)
cloud = ConstructCloud(Points=decloud.Points, Normals=decloud.Normals, Colors=weave)
cdel = DelaunayColored(Cloud=cloud, Plane=PlaneXY(0, 0, 0))
