# Grasshopper definition PointCloudVegetationNDVIanalysis.gh (Grasshopper 1.0.4)
# plug-ins: Volvox, NDVIColorRange, NDVICalculator

path = FilePath("C:\Users\darks\Desktop\PhotogrammetryWorkshop\valldaura\valldaura.pts")
number_slider = Slider(0.001, range=0..0.01)
cloudload = LoadCloud(FilePath=path, Mask="x y z n r g b", Percent=Slider(0.09, range=0..0.1))
decloud = DeconstructCloud(Cloud=cloudload)  # -> Points, Normals, simplify(Colors)
panel = Panel(decloud.Colors)
data = Data(decloud.Colors)
argb = SplitARGB(Colour=data)  # -> Alpha, Red, Green, Blue
ndvical = NDVICalculator(NIR=argb.Red, VIS=argb.Blue)
multiplication = Multiplication(A=ndvical, B=Slider(2, range=0..10))
ndvicolor = NDVIColorRange(NDVI=multiplication)
cloud = ConstructCloud(Points=decloud.Points, Normals=decloud.Normals, Colors=ndvicolor)
cdel = DelaunayColored(Cloud=cloud, Plane=PlaneXY(0, 0, 0))
voxelc = VoxelColored(Cloud=cloud, VoxelSize=Slider(1, range=0.5..10))  # disabled
